# Grasshopper definition hello.gh (Grasshopper 1.0.8)
# plug-ins: Conduit+

# ---- group: 1 Your data · six rooms, metres
room_names = Panel("""Studio 01
Studio 02
Meeting 01
Meeting 02
Store 01
Store 02""")
programme = Panel("""Studio
Studio
Meeting
Meeting
Store
Store""")
area_m² = Panel("""12
18
15
24
9
12""")
keys_match_link_defaults = Panel("""1
2
3
4
5
6""")
six_room_faces_metres = Rectangle([{Plane=PlaneXY(0, 0, 0), Size=Domain2(u=0..4, v=0..3)}, {Plane=PlaneXY(10, 0, 0), Size=Domain2(u=0..6, v=0..3)}, {Plane=PlaneXY(20, 0, 0), Size=Domain2(u=0..5, v=0..3)}, {Plane=PlaneXY(0, 5, 0), Size=Domain2(u=0..8, v=0..3)}, {Plane=PlaneXY(10, 5, 0), Size=Domain2(u=0..3, v=0..3)}, {Plane=PlaneXY(20, 5, 0), Size=Domain2(u=0..4, v=0..3)}])
boundary = BoundarySurfaces(Edges=six_room_faces_metres)  # -> flatten(Surfaces)

# ---- group: 2 Cards · programme colours + preview
colcat = ColourCategories(Categories=programme, Keys=keys_match_link_defaults, Palette="Programme", Title="Programme", Slot="tr", ShowCounts=True)  # -> Colours, Legend, Categories, CategoryColours, GroupKeys, Members
programme_preview = CustomPreview(Geometry=boundary, Material=colcat.Colours)

# ---- group: 3 Show it · Overlay + stacked Canvas Card
link = Link(Geometry=boundary)
entwine = Entwine(Branch00=room_names, Branch01=programme, Branch02=area_m², FlattenInputs=True)
bar = Bar(
    Values=area_m²,
    Labels=room_names,
    Keys=keys_match_link_defaults,
    Title="Area ≥ 15 m²",
    Threshold=15,
    Slot="tl",
    GoodWhen="Above",
    Sort="Worst first",
    VisibleRows=12,
    ConduitPlus_DefaultsVersion=1)
table = Table(
    Headers=["Room", "Type", "Area m²"],
    Keys=keys_match_link_defaults,
    Title="Room schedule",
    Slot="tr",
    VisibleRows=6,
    Width=360,
    Columns=entwine,
    Decimals=1)
metric = Metric(Value=["90", "3"], Title=["Total area", "Rooms below 15 m²"], Unit=["m²", ""], Slot="tl", Decimals=0)
merge = Merge(Data1=flatten(metric), Data2=flatten(bar), Data3=flatten(table), Data4=flatten(colcat.Legend))
merge_2 = Merge(Data1=flatten(metric), Data2=flatten(bar), Data3=flatten(table))
scope = Scope(Name="Room review")
overlay = Overlay(Cards=merge, Links=link, Scope=scope, ConduitPlus_Theme="Auto")  # -> Selection, Events
canvas_card = CanvasCard(Cards=merge_2, Scope=scope, ConduitPlus_CanvasTheme="Paper")
