# Grasshopper definition showcase.gh (Grasshopper 1.0.8)
# plug-ins: Conduit+

# ---- group: 1 Room data · schematic minima, not regulations
plan_scale = Slider(1, range=0.5..2)
rooms = DemoRooms(PlanScale=plan_scale)  # -> Rooms, Keys, Names, AreaDelta, Rows, GIA, NetToGross, Circulation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

# ---- group: 2 Matching colours · helper → Custom Preview + Legend
second_plan_offset = Vector(Vector(24, 0, 0))
colscale = ColourScale(Values=rooms.Areas, Palette="Blue", Min=0, Max=40, Unit="m²", Title="02 Area", Slot="br")  # -> Colours, Legend
colcat = ColourCategories(
    Categories=rooms.RoomTypes,
    Keys=rooms.Keys,
    Palette="Programme",
    Order=rooms.Types,
    Title="01 Programme",
    Slot="tr",
    ShowCounts=True)  # -> Colours, Legend, Categories, CategoryColours, GroupKeys, Members
programme_preview = CustomPreview(Geometry=rooms.Rooms, Material=colcat.Colours)
move = Move(Geometry=rooms.Rooms, Translation=second_plan_offset)
area_preview = CustomPreview(Geometry=move, Material=colscale.Colours)
entwine = Entwine(Branch00=flatten(rooms.Rooms), Branch01=flatten(move), FlattenInputs=True)
flip = FlipMatrix(Data=entwine)

# ---- group: 5 Structure reference · Demo Truss, all card kinds in one stack
truss = DemoTruss(Span=24, Bays=4, Depth=3, Load=12)  # -> Members, Keys, Labels, Utilisation, Deflection, Mass, Rows, MaxUtilisation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
bar = Bar(
    Values=truss.Utilisation,
    Labels=truss.Labels,
    Title="Utilisation ≤ 1",
    Threshold=1,
    VisibleRows=5,
    ConduitPlus_DefaultsVersion=1)
legend = Legend(Colors=[RGB(232, 239, 244), RGB(53, 102, 135)], Min=0, Max=12, Unit="mm", Title="Deflection reference")
table = Table(Headers=["Member", "Type", "Util.", "Length m"], Rows=truss.Rows, Title="Member results", VisibleRows=4, Width=360)
line = Line(Values=truss.Deflection, Labels=truss.Stations, Title="Deflection (mm)", Threshold=12)
metric = Metric(Value=truss.MaxUtilisation, Title="Max utilisation", Decimals=2)
text = Text(
    Title="Illustrative truss",
    Text="""Four bays, simply supported.
Fictitious stiffness and capacities.
Not structural verification.""",
    Width=280)
title = Title(Title="STRUCTURE / REFERENCE", Subtitle="Independent canvas study", Background="Card")
merge = Merge(
    Data1=flatten(metric),
    Data2=flatten(bar),
    Data3=flatten(line),
    Data4=flatten(table),
    Data5=flatten(legend),
    Data6=flatten(title),
    Data7=flatten(text))
canvas_card = CanvasCard(Cards=merge, ConduitPlus_CanvasTheme="Paper")

# ---- group: 6 Massing reference · grouped Bar from Colour Categories
massing = DemoMassing(ExtraFloors=0)  # -> Blocks, Keys, HeightRatios, Rows, GFA, AllowedGFA, FAR, Uses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
colcat_2 = ColourCategories(
    Categories=massing.BlockUses,
    Keys=massing.Keys,
    Palette="Programme",
    Order=massing.Uses,
    Title="Legend",
    ShowCounts=True)  # -> Colours, Legend, Categories, CategoryColours, GroupKeys, Members
bar_2 = Bar(
    Values=massing.GFAByUse,
    Labels=colcat_2.Categories,
    Keys=colcat_2.GroupKeys,
    Title="GFA by use (m²)",
    Colors=colcat_2.CategoryColours,
    Members=colcat_2.Members,
    VisibleRows=12,
    ConduitPlus_DefaultsVersion=1)
metric_2 = Metric(Value=massing.FAR, Title="FAR / allowed 2.0", Decimals=2)
keylegend = KeyLegend(Keys=colcat_2.Categories, Colors=colcat_2.CategoryColours, Title="Uses")
merge_2 = Merge(Data1=flatten(bar_2), Data2=flatten(keylegend), Data3=flatten(metric_2))
canvas_card_2 = CanvasCard(Cards=merge_2, ConduitPlus_CanvasTheme="Paper")

# ---- group: 3 Room review · stacked cards, shared Scope + Overlay
link = Link(Geometry=flip, Keys=flatten(rooms.Keys))
flip_2 = FlipMatrix(Data=rooms.Rows)
metric_3 = Metric(
    Value=flatten([rooms.GIA, rooms.NetToGross]),
    Title=["Schematic GIA", "Net / gross"],
    Unit=["m²", "%"],
    Slot="tl",
    Decimals=[0, 1])
bar_3 = Bar(
    Values=rooms.AreaDelta,
    Labels=rooms.Names,
    Keys=rooms.Keys,
    Title="Area − minimum (m²)",
    Threshold=0,
    Slot="tl",
    GoodWhen="Above",
    Sort="Worst first",
    VisibleRows=12,
    ConduitPlus_DefaultsVersion=1)
table_2 = Table(
    Headers=["Room", "Type", "Area m²", "Min m²", "Δ m²", "Status"],
    Keys=rooms.Keys,
    Title="Room schedule",
    Slot="tr",
    VisibleRows=7,
    Width=460,
    Columns=flip_2,
    Decimals=1)
metric_4 = Metric(
    Value=rooms.FailingRooms,
    Title="Rooms below minimum",
    Slot="tl",
    Decimals=0,
    Key="below-minimum",
    Members=rooms.FailingMembers)
title_2 = Title(Title="ROOM / AREA REVIEW", Subtitle="01 Programme    /    02 Area", Position="tc")
merge_3 = Merge(Data1=flatten(title_2), Data2=flatten(metric_3), Data3=flatten(metric_4), Data4=flatten(bar_3), Data5=flatten(table_2))
scope = Scope(Name="Room review")
canvas_card_3 = CanvasCard(Cards=merge_3, Scope=scope, ConduitPlus_CanvasTheme="Paper")

# ---- group: 4 Design allowance · Within ±2 + programme palette
colpal = ColourPalette(Style="Programme", Count=6, Shift=0)  # -> Colours, Hex
cull_i = CullIndex(List=rooms.AreaDelta, Indices=16, Wrap=True)
cull_i_2 = CullIndex(List=rooms.Names, Indices=16, Wrap=True)
cull_i_3 = CullIndex(List=rooms.Keys, Indices=16, Wrap=True)
bar_4 = Bar(
    Values=cull_i,
    Labels=cull_i_2,
    Keys=cull_i_3,
    Title="Minimum allowance ±2 m²",
    Threshold=2,
    GoodWhen="Within",
    Sort="Worst first",
    VisibleRows=6,
    ConduitPlus_DefaultsVersion=1)
bar_5 = Bar(
    Values=rooms.Areas,
    Labels=rooms.Names,
    Keys=rooms.Keys,
    Title="Room area (m²)",
    VisibleRows=6,
    ConduitPlus_DefaultsVersion=1)
text_2 = Text(
    Title="Reading the review",
    Text="""Left plan: programme. Right plan: area.
Area − minimum ≥ 0 passes; ±2 is a separate allowance study (hall excluded).
Click replaces; Shift adds; Ctrl removes; Ctrl+Shift toggles.
Clear or plain empty viewport click clears. Escape cancels gestures.
Canvas wheel zooms; use card scrollbars.
Illustrative data, not a regulatory check.""",
    Width=340)
keylegend_2 = KeyLegend(Keys=rooms.Types, Colors=colpal.Colours, Title="Programme palette")
merge_4 = Merge(Data1=flatten(bar_4), Data2=flatten(bar_5), Data3=flatten(text_2), Data4=flatten(keylegend_2))
canvas_card_4 = CanvasCard(Cards=merge_4, Scope=scope, ConduitPlus_CanvasTheme="Paper")

# ---- group: 3 Room review · stacked cards, shared Scope + Overlay (continued)
merge_5 = Merge(
    Data1=flatten(title_2),
    Data2=flatten(metric_3),
    Data3=flatten(metric_4),
    Data4=flatten(bar_3),
    Data5=flatten(table_2),
    Data6=flatten(colcat.Legend),
    Data7=flatten(colscale.Legend),
    Data8=flatten(text_2),
    Data9=flatten(keylegend_2))
overlay = Overlay(Cards=merge_5, Links=link, Scope=scope, ConduitPlus_Theme="Auto")  # -> Selection, Events
